# Grasshopper definition window_in_wall_design_doublelayer_am_model_fab.ghx (Grasshopper 1.0.7)

reload = Button()
py = PythonScript(reload=reload)
# ---------- py: Python ----------
from compas_rhino.utilities.misc import get_tolerance
from compas_rhino.utilities.misc import unload_modules

from compas_ghpython import unload_modules

unload_modules("compas")
unload_modules("compas_fab")
unload_modules("ur_fabrication_control")
unload_modules("assembly_information_model")
unload_modules("am_information_model") 
unload_modules("window_in_wall")
# ---------- end py ----------
py_2 = PythonScript()  # -> HERE, DATA
# ---------- py_2: Python ----------
import os

HERE = os.path.dirname(ghdoc.Path)
DATA = os.path.abspath(os.path.join(HERE, "..", "data"))

#print(HERE)
#print(DATA)
# ---------- end py_2 ----------

# ----
# If gate_type:  interactive
crv_gate_right = Curve(<curve referenced from the Rhino model>)
crv_gate_left = Curve(<curve referenced from the Rhino model>)

toggle = BooleanToggle(True)

# ---- group: DESIGN / Shape Initialization
list = ValueList({"circular", "persian", "interactive", "triangular", "catenary"}, selected="persian")
width = Number(5.6)
height = Number(2.7)
elsize = Number(0.05)
create_wall = GhPythonScript(init=Button(), width=width, height=height, elsize=elsize, double_layer=toggle)  # -> wall
# ---------- create_wall: Python ----------
from window_in_wall import Wall


# create wall
wall = Wall()

print len(list(wall.mesh_offset.vertices()))

# construct COMPAS quad mesh from width and height

if double_layer == True:
    wall.create_quad_meshes_from_dimensions_dl(width, height, elsize)

if double_layer == False:
    wall.create_quad_meshes_from_dimensions(width, height, elsize)

#print wall.mesh
# ---------- end create_wall ----------
define_gate = GhPythonScript(
    wall=create_wall,
    gate_type=list,
    gate_x=Slider(2.4, range=1..3),
    gate_size=Slider(1.845, range=0..2),
    gate_crv_left=crv_gate_left,
    gate_crv_right=crv_gate_right)  # -> out, wall, gate_crv_left, gate_crv_right, wall_crv_left, wall_crv_right, wall_crv_middle; inputs gate_crv_left: Curve, gate_crv_right: Curve
# ---------- define_gate: Python ----------
import math
import compas
import Rhino as rh
import ghpythonlib.components as ghcomp
from compas.datastructures import Mesh

import Rhino.Geometry as rg

# Create wall curves left and right
wall_crv_left = rg.Line(rg.Point3d(0,0,0), rg.Point3d(0,0,wall.height))
wall_crv_right = rg.Line(rg.Point3d(wall.width,0,0), rg.Point3d(wall.width,0,wall.height))

# --- catenary functions ---
def catenary_y(a,x):
    try:
        ans = a*math.cosh(x/a)
    except OverflowError:
        ans = float('inf')
    return ans

def define_catenary_a(cat_width, cat_height, tol=0.0001):
    length = cat_width/2
    an, an1, da = (1, 1, 0.1)
    hn = catenary_y(an, length)-an
    hn1 = hn
    for i in range(1000):
        dhn = hn-cat_height
        dhn1 = hn1-cat_height
        if (hn1 > cat_height and abs(dhn1)>abs(dhn)) or hn1==float('inf'):
            da = da/10
        if abs(dhn)<tol:
            break
        elif dhn<0:
            an = an-da
            an1 = an-da
        elif dhn>0:
            an = an+da
            an1 = an+da
        hn = catenary_y(an,length)-an
        hn1 = catenary_y(an1,length)-an1
    return an
# --- end of catenary functions ---

if gate_type == "interactive":
    # Create wall curve above gate
    gate_left_pts = ghcomp.EndPoints(curve=gate_crv_left)
    if gate_left_pts[0].Z > gate_left_pts[1].Z:
        gate_top_pt = gate_left_pts[0]
    else:
        gate_top_pt = gate_left_pts[1]
    gate_x = gate_top_pt.X
elif gate_type == "catenary":
    cat_a = define_catenary_a(gate_size, gate_size)

# Define gate
for vertex in wall.mesh.vertices():
    # get x and z coordinates from vertex
    x_val = wall.mesh.vertex_attribute(vertex, name='x')
    z_val = wall.mesh.vertex_attribute(vertex, name='z')

    # calculate distance
    gate_rel_x = gate_x-x_val
    gate_rel_z = z_val

    #in order to avoid division by zero. should be cleaned up ASAP
    if gate_rel_x==0:
        gate_rel_x=0.000000001

    #this boolean will be set to True if vertex lies inside the gate 
    in_gate_vertex = False

    #for each gate tpye, the a corresponding function is called to check
    # to check if vertex lies inside the gate
    if gate_type=="circular":
        if wall.in_gate_circular(gate_size, gate_rel_x,gate_rel_z):
            in_gate_vertex = True
    elif gate_type=="persian":
        if wall.in_gate_persian(gate_size, gate_rel_x,gate_rel_z):
            in_gate_vertex = True
    elif gate_type=="triangular":
        if wall.in_gate_triangular(gate_size, gate_rel_x,gate_rel_z):
            in_gate_vertex = True
    elif gate_type=="catenary":
        if wall.in_gate_catenary(gate_size, gate_rel_x, gate_rel_z, cat_a):
            in_gate_vertex = True
    elif gate_type=="interactive":
        point = rh.Geometry.Point3d(wall.mesh.vertex_attribute(vertex, name='x'), 0, wall.mesh.vertex_attribute(vertex, name='z') )
        point_in_gate = ghcomp.PointInCurve(point,gate_crv).relationship
        if point_in_gate == 2 or point_in_gate == 1: 
            in_gate_vertex = True

    if in_gate_vertex:
        # store new vertex attribute with the distance to the gate center
        wall.mesh.vertex_attribute(vertex,"x_disp", value=-gate_rel_x)
        wall.mesh.vertex_attribute(vertex,"z_disp", value=gate_rel_z)
        #in_gate flag indicates that this vertex lies in the gate
        wall.mesh.vertex_attribute(vertex,"in_gate", value=True)
        wall.gate_points.append(vertex)

if gate_type=="circular":
    center_pt = rg.Point3d(gate_x,0,0)
    start_pt = rg.Point3d(gate_x-gate_size,0,0)
    middle_left_pt = rg.Point3d(gate_x-(gate_size*(math.sqrt(2)/2)),0,gate_size*(math.sqrt(2)/2))
    middle_pt = rg.Point3d(gate_x,0,gate_size)
    middle_right_pt = rg.Point3d(gate_x+(gate_size*(math.sqrt(2)/2)),0,gate_size*(math.sqrt(2)/2))
    end_pt = rg.Point3d(gate_x+gate_size,0,0)
    gate_crv_left = ghcomp.Arc3Pt(start_pt, middle_left_pt, middle_pt)[0]
    gate_crv_right = ghcomp.Arc3Pt(middle_pt, middle_right_pt, end_pt)[0]
elif gate_type=="triangular":
    start_pt = rg.Point3d(gate_x-gate_size,0,0)
    middle_pt = rg.Point3d(gate_x,0,gate_size)
    end_pt = rg.Point3d(gate_x+gate_size,0,0)
    gate_crv_left = ghcomp.Line(start_pt, middle_pt)
    gate_crv_right = ghcomp.Line(end_pt, middle_pt)
elif gate_type=="persian":
    pers_radius = (1/3)*gate_size
    start_pt = rg.Point3d(gate_x-pers_radius,0,0)
    y1 = pers_radius*(math.sqrt(2.5-math.sqrt(2))+math.sqrt(2)/2)
    arc1_start_pt = rg.Point3d(gate_x-pers_radius,0,y1)
    arc2_start_pt = rg.Point3d(gate_x+pers_radius,0,y1)
    y2 = pers_radius*(math.sqrt(2.5-math.sqrt(2))+math.sqrt(2))
    int_relx = math.sqrt(pers_radius**2-(y2-y1)**2)
    arc1_int_pt = rg.Point3d(gate_x-(int_relx)*(math.sqrt(3)/math.sqrt(2)),0,y1+(y2-y1)/(math.sqrt(2)))
    arc2_int_pt = rg.Point3d(gate_x+(int_relx)*(math.sqrt(3)/math.sqrt(2)),0,y1+(y2-y1)/(math.sqrt(2)))
    
    arc1_end_pt = rg.Point3d(gate_x-int_relx,0,y2)
    arc2_end_pt = rg.Point3d(gate_x+int_relx,0,y2)
    y3 = math.sqrt(4*(pers_radius**2)-int_relx**2)+y2-2*(y2-y1)
    top_pt = rg.Point3d(gate_x,0,y3)
    arc3_int_pt = rg.Point3d(gate_x+int_relx-(2*int_relx)/math.sqrt(2),0,y1-(y2-y1)+2*(y2-y1)*(math.sqrt(3)/math.sqrt(2)))
    arc4_int_pt = rg.Point3d(gate_x-int_relx+(2*int_relx)/math.sqrt(2),0,y1-(y2-y1)+2*(y2-y1)*(math.sqrt(3)/math.sqrt(2)))
    
    end_pt = rg.Point3d(gate_x+pers_radius,0,0)
    gate_vert_left = ghcomp.Line(start_pt, arc1_start_pt)
    gate_vert_right = ghcomp.Line(end_pt, arc2_start_pt)
    arc1_crv = ghcomp.Arc3Pt(arc1_start_pt, arc1_int_pt, arc1_end_pt)
    arc2_crv = ghcomp.Arc3Pt(arc2_start_pt, arc2_int_pt, arc2_end_pt)
    arc3_crv = ghcomp.Arc3Pt(arc1_end_pt, arc3_int_pt, top_pt)
    arc4_crv = ghcomp.Arc3Pt(arc2_end_pt, arc4_int_pt, top_pt)
    
    gate_crv_left = ghcomp.JoinCurves([gate_vert_left, arc1_crv[0], arc3_crv[0]], False)
    gate_crv_right = ghcomp.JoinCurves([gate_vert_right, arc2_crv[0], arc4_crv[0]], False)
elif gate_type=="catenary":
    start_pt = rg.Point3d(gate_x-gate_size/2,0,0)
    end_pt = rg.Point3d(gate_x+gate_size/2,0,0)
    pts_left = [rg.Point3d(gate_x-((gate_size/2)/5)*i, 0, gate_size-catenary_y(cat_a, ((gate_size/2)/5)*i)+cat_a) for i in range(6)]
    pts_right = [rg.Point3d(gate_x+((gate_size/2)/5)*i, 0, gate_size-catenary_y(cat_a, ((gate_size/2)/5)*i)+cat_a) for i in range(6)]
    pts_left[-1] = start_pt
    pts_right[-1] = end_pt
    gate_crv_left = ghcomp.Interpolate(pts_left, 3, False, 0)[0]
    gate_crv_right = ghcomp.Interpolate(pts_right, 3, False, 0)[0]
    gate_crv_left.Reverse()
    gate_crv_right.Reverse()

# Create gate curve
gate_crv_top = ghcomp.JoinCurves(curves=[gate_crv_left, gate_crv_right], preserve=False)
gate_end_pts = ghcomp.EndPoints(curve=gate_crv_top)
gate_crv_bottom = rg.Line(gate_end_pts[0], gate_end_pts[1])
gate_crv = ghcomp.JoinCurves(curves=[gate_crv_top, gate_crv_bottom], preserve=False)

# Create wall curve above gate
gate_left_pts = ghcomp.EndPoints(curve=gate_crv_left)
if gate_left_pts[0].Z > gate_left_pts[1].Z:
    gate_top_pt = gate_left_pts[0]
else:
    gate_top_pt = gate_left_pts[1]
wall_crv_middle = rg.Line(gate_top_pt, rg.Point3d(gate_top_pt.X, gate_top_pt.Y, wall.height))
# ---------- end define_gate ----------
crv = Curve(define_gate.gate_crv_left)
crv_2 = Curve(define_gate.gate_crv_right)
crv_3 = Curve(define_gate.wall_crv_left)
crv_4 = Curve(define_gate.wall_crv_right)
crv_5 = Curve(define_gate.wall_crv_middle)
preview = CustomPreview(Geometry=[crv, crv_2, crv_3, crv_4, crv_5], Material=ColourSwatch(SwatchColor=RGB(0, 0, 0)))

# ----
down_phase = Slider(0, range=0..3)
up_amp = Slider(0.03, range=0..0.3)

# ---- group: DESIGN / Shape Manipulation
down_amp = Slider(0.08, range=0..0.3)
down_freq = Slider(1.857, range=1..3)
up_phase = Slider(0, range=0..3)
up_freq = Slider(1, range=1..3)
displacement = GhPythonScript(wall=define_gate.wall, compute_displ=Button(), visualize_displ=Toggle(False))  # -> out, wall
# ---------- displacement: Python ----------
from compas.rpc import Proxy


if compute_displ:
    #wall_methods_numpy = Proxy('window_in_wall.wall_methods_numpy')
    with Proxy('window_in_wall.wall_methods_pde') as wall_methods_pde:
        #wall_methods_numpy.stop_server() #if changes need to be reloaded
        #wall_methods_numpy.start_server()
        
        # compute displacement
        #solX, solZ = wall_methods_numpy.compute_displacement(wall.mesh,wall.gate_points, wall.x_size, wall.z_size)
        solX = wall_methods_pde.compute_displacement_x(wall.mesh, wall.gate_points, wall.x_size, wall.z_size)
        solZ = wall_methods_pde.compute_displacement_z(wall.mesh, wall.gate_points, wall.x_size, wall.z_size)
    
    # update vertex attributes with displacement values
    for v, data in wall.mesh.vertices(data=True):        
        wall.mesh.vertex_attribute(v, "x_disp", value=solX[v]) #value=solX[n_from_ij(i,j, wall.z_size)]
        wall.mesh.vertex_attribute(v, "z_disp", value=solZ[v]) #value=solZ[n_from_ij(i,j, wall.z_size)]

if visualize_displ:
    # displace the vertices (for preview only)
    wall.displace_vertices()
    #solmat = np.reshape(solX, (-1, n))
# ---------- end displacement ----------
wave = GhPythonScript(
    wall=displacement.wall,
    wave=Toggle(True),
    up_amp=up_amp,
    up_freq=up_freq,
    up_phase=up_phase,
    down_amp=down_amp,
    down_freq=down_freq,
    down_phase=down_phase)  # -> out, wall; inputs wave: Boolean
# ---------- wave: Python ----------
if wave:
    #wall.undulate(amp, freq, phase)
    #wall.undulate(up_amp, up_freq, up_phase, down_amp, down_freq, down_phase)
    wall.undulate_with_displ(up_amp, up_freq, up_phase, down_amp, down_freq, down_phase)
    #wall.undulate_with_displ(amp, freq, phase)
# ---------- end wave ----------

# ----
xy = XYPlane(Origin=Point(0, 0, 0))
create = Button()

# ---- group: Visualise
list_2 = ValueList({"20", "50", "100", "500", "1000", "5000"}, selected="20")
back = Button()
reset = Button()
start = Button()
stop = Button()
step = Button()
full = Button()

# ----
# 1.
# Settings
bang = Button()
panel = Panel("Unload libraries")
unload = PythonScript(bang=bang)
# ---------- unload: Python ----------
from compas_rhino.utilities.misc import get_tolerance
from compas_rhino.utilities.misc import unload_modules

unload_modules("compas")
unload_modules("compas_fab")
unload_modules("ur_fabrication_control")
unload_modules("mobile_additive_manufacturing")
unload_modules("am_information_model")
unload_modules("src")
# ---------- end unload ----------

ext_ip = ValueList({"192.168.10.10", "192.168.10.20", "192.168.10.11", "192.168.10.12", "127.0.0.1", "192.168.10.111", "192.168.0.30", "192.168.10.50"}, selected="192.168.10.50")
ext_port = ValueList({"50003", "50004"}, selected="50004")

# ----
# --> Set your IP address
# --> Set robot IP address
server_ip = ValueList({"192.168.10.44", "192.168.10.12", "192.168.10.11", "192.168.10.10", "192.168.10.2", "127.0.0.1", "192.168.10.111", "192.168.0.30"}, selected="192.168.10.11")
ur_ip = ValueList({"192.168.10.10", "192.168.10.20", "192.168.10.11", "192.168.10.12", "127.0.0.1", "192.168.10.111", "192.168.0.30"}, selected="192.168.10.20")
server_port = ValueList({"50002", "50003", "50004", "50005"}, selected="50002")
ur_port = ValueList({"30002"}, selected="30002")
globals = PythonScript(
    server_address=server_ip,
    server_port=server_port,
    ur_ip=ur_ip,
    ur_port=ur_port,
    ext_ip=ext_ip,
    ext_port=ext_port,
    clear=Button())  # inputs server_port: Int32
# ---------- globals: Python ----------
from scriptcontext import sticky as st

st["server_address"] = server_address
st["server_port"] = server_port

st["ur_ip"] = ur_ip
st["ur_port"] = ur_port

st["ext_ip"] = ext_ip
st["ext_port"] = ext_port


if clear:
    st.clear()
# ---------- end globals ----------

# ----
# Check if UR robot
#  is available
ping = Button()
py_3 = PythonScript(ip=ur_ip, ping=ping)  # -> out, trigger
# ---------- py_3: Python ----------
from scriptcontext import sticky as st
from ur_fabrication_control.direct_control.utilities import is_available

guid = str(ghenv.Component.InstanceGuid)
txt_key = "txt_" + guid
if txt_key not in st:
    st[txt_key] = ""

if ping:
    
    available = is_available(ip)
    
    if available:
        st[txt_key] = "%s is up!" % ip
        trigger = True
    else:
        st[txt_key] = "%s is down!" % ip
        trigger = False

print(st[txt_key])
# ---------- end py_3 ----------
panel_2 = Panel(py_3.out)

data = Data("Grasshopper.Kernel.Types.GH_ObjectWrapper")
cp = Plane(Plane(origin=(-1.026602616, -0.03965357101, -0.4442693296), x=(-0.01795929223, -0.9998379119, 0.001270365803), y=(0.9997696103, -0.0179729749, -0.01173449636)))
generate_assembly = GhPythonScript(create=Button(), centerplane=cp, init_am_model=data)  # -> am_model
# ---------- generate_assembly: Python ----------
import Rhino.Geometry as rg
import math
from scriptcontext import sticky as st


from compas.geometry import Frame
from compas.geometry import Transformation
from compas.geometry import Scale
from compas.geometry import Point

from compas_ghpython import draw_frame

from am_information_model.model import AMModel
from am_information_model.model import Layer

import Rhino.Geometry as rg

# initialize an empty assembly class

if "am_model" not in st:
    st["am_model"] = None

cp = centerplane
cf = Frame(cp.Origin, cp.XAxis, cp.YAxis)

T = Transformation.from_frame_to_frame(Frame.worldXY(), cf)


def transform_layers_from_am_model(amm, init_amm):
    for key, layer in init_amm.layers():
        new_layer = layer.transformed(T)
        amm.add_layer(new_layer)

if create:
    new_amm = AMModel()
    transform_layers_from_am_model(new_amm, init_am_model)
    st["am_model"] = new_amm

am_model = st["am_model"]
# ---------- end generate_assembly ----------
list_3 = ValueList({"ur3.urdf", "ur3_rot.urdf", "ur5.urdf", "ur10.urdf", "ur3e.urdf", "ur5e.urdf", "ur10e.urdf", "ur10e_rot.urdf"}, selected="ur10e_rot.urdf")
# Exchange the group in your gh definition to add the xl_nozzle.
# Make sure to attach all lines back again
list_4 = ValueList({"ur3.srdf", "ur5.srdf", "ur10.srdf", "ur3e.srdf", "ur5e.srdf", "ur10e.srdf"}, selected="ur10e.srdf")
# 2.
py_4 = PythonScript()  # -> DATA
# ---------- py_4: Python ----------
import os
import ur_fabrication_control

package_path = ghdoc.Path
# package_path = os.path.dirname(ur_fabrication_control.__file__)
DATA = os.path.abspath(os.path.join(package_path,"../../../ur_fabrication_control/data"))
print(package_path)
print(DATA)
# ---------- end py_4 ----------

# ----
# Robot Model
# Load Model
list_5 = ValueList({"ur_description", "ur_e_description", "ur_setups"}, selected="ur_e_description")
py_5 = PythonScript(data_path=py_4, package=list_5, urdf_name=list_3, srdf_name=list_4)  # -> loaders, urdf_filename, srdf_filename
# ---------- py_5: Python ----------
import os
from compas.robots import LocalPackageMeshLoader

path = os.path.join(data_path, "robot_description")

#loaders
packages = ["ur_description", "ur_e_description", "ur_end_effectors", "ur_setups"]
loaders = [LocalPackageMeshLoader(path, pck) for pck in packages]

#files
package_path = os.path.join(path, package)
print package_path

urdf_filename = os.path.join(package_path, "urdf", urdf_name)
srdf_filename = os.path.join(package_path, srdf_name)

assert os.path.isfile(urdf_filename)
assert os.path.isfile(srdf_filename)
# ---------- end py_5 ----------
load = Button()
units = ValueList({"m": 1, "cm": 100, "mm": 1000}, selected="m")
create_2 = PythonScript(load=load, loaders=py_5.loaders, urdf_filename=py_5.urdf_filename, srdf_filename=py_5.srdf_filename, scale_factor=units)  # -> out, robot; inputs load: Boolean, loaders: list
# ---------- create_2: Python ----------
import os
from scriptcontext import sticky as st

import compas

from compas.robots import RobotModel
from compas.robots import LocalPackageMeshLoader

from compas_fab.robots import Robot
from compas_fab.robots import RobotSemantics
from compas_fab.ghpython import RobotArtist

compas.PRECISION = '12f'

# store robot in component
guid = str(ghenv.Component.InstanceGuid)
robot_key = "robot"

if robot_key not in st:
    st[robot_key] = None

print loaders
if load:
    model = RobotModel.from_urdf_file(urdf_filename)
    
    model.load_geometry(*loaders)
    artist = RobotArtist(model)
    semantics = RobotSemantics.from_srdf_file(srdf_filename, model)
    robot = Robot(model, artist, semantics, client=None)
    
    st[robot_key] = robot

robot = st[robot_key]


if robot:
    robot.scale(scale_factor)
# ---------- end create_2 ----------
robot = Data(create_2.robot)

py_6 = PythonScript()  # -> DATA
# ---------- py_6: Python ----------
import os

#package_path = os.path.dirname(mobile_additive_manufacturing.__file__)
#DATA = os.path.abspath(os.path.join(package_path,"../../data"))

package_path = ghdoc.Path
# package_path = os.path.dirname(ur_fabrication_control.__file__)
DATA = os.path.abspath(os.path.join(package_path,"../../../../development/mobile_additive_manufacturing/data"))

print(package_path)
print(DATA)
# ---------- end py_6 ----------

# ----
# Tool
list_6 = ValueList({"measurement_tool": 0, "clay_extruder_7mm": 1, "clay_extruder_5mm": 2, "clay_extruder_extra_long_nozzle": 3}, selected="clay_extruder_7mm")
panel_3 = Panel("Attach a custom tool")
show = BooleanToggle(False)
python = PythonScript(data_path=py_6, tool=list_6, show=show)  # -> tool, M
# ---------- python: Python ----------
import os, math
from compas.geometry import Frame, Rotation
from compas.datastructures import Mesh
from compas_ghpython.artists import MeshArtist
from compas_fab.robots import Tool

tolerance = 0

if tool == 0:
    filename = 'measurement_tool_zaxis.stl'
    ee_frame = Frame([0, 0, 0.109], [1, 0, 0], [0, 1, 0])

elif tool == 1:
    filename = 'clay_extruder_7mm.stl'
    # real frame:
    ee_frame = Frame([-0.000502, -0.105348, 0.0662,], [1, 0, 0], [0, 0, 1])
    
    # test frame:
    # ee_frame = Frame([0.0, 0.0, 0.1,], [1, 0, 0], [0, 1, 0])
elif tool == 2:
    filename = 'clay_extruder_5mm.stl'
    # non-rotated frame:
    ee_frame = Frame([-0.000502, -0.107348, 0.0662,], [1, 0, 0], [0, 0, 1])
elif tool == 3:
    filename = 'clay_extruder_extra_long_nozzle.stl'
    # non-rotated frame:
    ee_frame = Frame([-0.000502, -0.214848, 0.0662,], [1, 0, 0], [0, 0, 1])

data_path = os.path.join(data_path, "tool_geometry")
fullfilename = os.path.join(data_path, filename)
print fullfilename

ee_mesh = Mesh.from_stl(fullfilename)

#R = Rotation.from_axis_and_angle(ee_frame.zaxis, math.radians(180), point=ee_frame.point)
#ee_frame.transform(R)

if show:
    artist = MeshArtist(ee_mesh)
    M = artist.draw()

tool = Tool(ee_mesh, ee_frame)
# ---------- end python ----------
py_7 = PythonScript(robot=robot, tool=python.tool, attach=Toggle(True))  # -> a
# ---------- py_7: Python ----------
if attach:
    robot.attach_tool(tool)
else:
    robot.detach_tool()
# ---------- end py_7 ----------

# ----
# Info
info = PythonScript(robot=robot)  # -> out, main_group_name
# ---------- info: Python ----------
if robot:
    robot.info()
    main_group_name = robot.main_group_name
# ---------- end info ----------
panel_4 = Panel(info.out)

# ---- group: forward kinematics
a3 = Slider(90, range=-360..360)
a4 = Slider(0, range=-360..360)
a6 = Slider(0, range=-360..360)
# Configuration
# Info
a1 = Slider(0, range=-360..360)
a2 = Slider(-90, range=-360..360)
a5 = Slider(90, range=-360..360)
jp = GhPythonScript()  # -> joint_positions
# ---------- jp: Python ----------
import math

joint_positions = [0,-90,90,0,90,0]
joint_positions = [math.radians(a) for a in joint_positions]
#joint_positions = [-3.136, -0.328, -1.218, 3.129, 0.852, 0.008]
#joint_positions = [0] * 6



#joint_positions = [1.6239667567485938, 0.25439606475392273, 4.409424838594969-2*3.14, 3.1901607306255908, 1.5707963267948954, 0.053170429953696939]
#joint_positions = [1.598543436748912, 0.23021224965157744, 4.712232135219824-2*3.14, 6.0531299026928744, 4.7123889803846915, 0.027747109954015234]
#joint_positions = [-1.1373533430447322, 4.0117247163121572, 5.4083762087596021-2*3.14, 1.5754733624925168, 4.7123889803846879, 3.5750356373399574]
print joint_positions
# ---------- end jp ----------
forward_kinematics = PythonScript(robot=robot, set_joint_positions=Button(), joint_positions=jp, a1=a1, a2=a2, a3=a3, a4=a4, a5=a5, a6=a6)  # -> full_configuration; inputs joint_positions: list
# ---------- forward_kinematics: Python ----------
import math
import Grasshopper
from compas.robots import Joint
from compas_fab.robots import Configuration

if set_joint_positions:

    j = 0
    for i in range(ghenv.Component.Params.Input.Count):
        nslider = ghenv.Component.Params.Input[i].Sources[0]
        if nslider.GetType() == Grasshopper.Kernel.Special.GH_NumberSlider:
            nslider.TrySetSliderValue(math.degrees(joint_positions[j]))
            j += 1

if robot:
    joint_positions = [a1, a2, a3, a4, a5, a6]
    joint_types = robot.get_configurable_joint_types()
    for i, joint_type in enumerate(joint_types):
        if joint_type == Joint.REVOLUTE:
            joint_positions[i] = math.radians(joint_positions[i])
    full_configuration = Configuration(joint_positions, joint_types)
    
print(full_configuration)
# ---------- end forward_kinematics ----------

# ----
plane_nr = Slider(15, range=0..500)

# ---- group: Visualise
list_7 = ValueList({"20", "50", "100", "500", "1000", "5000"}, selected="100")
back_2 = Button()
reset_2 = Button()
start_2 = Button()
stop_2 = Button()
step_2 = Button()
full_2 = Button()

# ----
panel_5 = Panel("""10 - 39
9 - 79
8 - 0""")

# ---- group: Visualise
# 1. Visualise the entire assembly.
# 2. Visualise the assembly process by setting a counter and a speed.
counter = CountThroughList(
    am_model=generate_assembly,
    start=start_2,
    stop=stop_2,
    step=step_2,
    step_back=back_2,
    reset=reset_2,
    full=full_2,
    interval=list_7)  # -> item, counter; inputs start: Boolean, stop: Boolean, step_back: Boolean
# ---------- counter: Python ----------
from scriptcontext import sticky as st
from compas_ghpython import update_component


L = list(am_model.layers())
# store data in component
guid = str(ghenv.Component.InstanceGuid)
counter_key = "counter_" + guid
running_key = "running_" + guid

if counter_key not in st:
    st[counter_key] = 0

if running_key not in st:
    st[running_key] = False
    

if st[running_key]:
    if st[counter_key] < len(L) - 1:
        st[counter_key] += 1
        update_component(ghenv, interval)
    else:
        st[counter_key] = 0
        st[running_key] = False
    
    
if start:
    st[running_key] = True

if stop:
    st[running_key] = False

if step:
    if st[counter_key] < len(L) - 1:
        st[counter_key] += 1

if step_back:
    if st[counter_key] < len(L) - 1:
        st[counter_key] -= 1

if reset:
    st[counter_key] = 0

if full:
    st[counter_key] = len(L)-1

if len(L):
    item = L[st[counter_key]]



#st["visualisation_counter"] = st[counter_key]
counter = st[counter_key]
# ---------- end counter ----------
show_2 = BooleanToggle(True)
show_3 = BooleanToggle(False)
idx = Panel(counter.counter)
draw = PythonScript(am_model=generate_assembly, show_all=show_2, show_counter=show_3, counter=idx)  # -> G, tool_planes_WCS, current_tool_plane, current_layer_planes; inputs counter: Int32
# ---------- draw: Python ----------
import os
import sys

import math

from compas_ghpython.artists import MeshArtist
from compas_ghpython import draw_frame

#from assembly_information_model.artist import AssemblyArtist


G = []

key_index = am_model.network.key_index()
keys = [key_index[key] for key in am_model.network.nodes()]
layers = [am_model.layer(key) for key in keys] 

tool_planes_WCS = [draw_frame(layer.node(0).frame) for layer in layers]

current_tool_plane = tool_planes_WCS[counter]
current_layer_planes = [draw_frame(frame) for frame in layers[counter].path]

if show_all and not show_counter:
    for layer in layers:
        for key, node in layer.nodes():
            plane = draw_frame(node.frame)
            G.append(plane)

if show_counter:
    for layer in layers[0:counter+1]:
        for key, node in layer.nodes():
            plane = draw_frame(node.frame)
            G.append(plane)
# ---------- end draw ----------
geo = Geometry(draw.G)
pln = Plane(draw.current_tool_plane)
pln_2 = Plane(draw.tool_planes_WCS)
pln_3 = Plane(draw.current_layer_planes)
preview_2 = CustomPreview(Geometry=geo, Shader=ColourSwatch(SwatchColor=RGBA(255, 186, 220, 146)))

# ---- group: inverse kinematics
select_configuration = Slider(0, range=0..7)
inverse = PythonScript(robot=robot, planes_WCS=pln_3, plane_nr=plane_nr, idx=select_configuration)  # -> out, plane_tool0_RCS, plane_tcp_RCS, configuration; inputs planes_WCS: list of Plane, plane_nr: Int32, idx: Int32
# ---------- inverse: Python ----------
import Rhino.Geometry as rg
import math
from compas.geometry import Frame, Transformation, Rotation
from compas_fab.robots import Configuration
from ur_fabrication_control.kinematics.ur_kinematics import inverse_kinematics
from ur_fabrication_control.kinematics.ur_params import ur_params
from compas_ghpython import draw_frame

plane_WCS = planes_WCS[plane_nr]

tcp_WCS = Frame(plane_WCS.Origin, plane_WCS.XAxis, plane_WCS.YAxis)

# transform frame to robot coordinate system
tcp_RCS = robot.to_local_coordinates(tcp_WCS)
tool0_RCS = robot.from_tcf_to_t0cf([tcp_RCS])[0]

print tcp_RCS
print tool0_RCS
plane_tool0_RCS = draw_frame(tool0_RCS)
plane_tcp_RCS = draw_frame(tcp_RCS)
# calculate solutions to frame
ur_params = ur_params[robot.name] # get the parameters according to the robot model
solutions = inverse_kinematics(tool0_RCS, ur_params)

if not len(solutions):
    joint_values = [0,0,0,0,0,0]
    configuration = Configuration.from_revolute_values(joint_values)
else:
    joint_values = solutions[idx]
    #print joint_values
    
    ### ***** HACK ***** ##### TODO: CHECK!!!
    for i, v in enumerate(joint_values):
        if v > math.pi:
            v -= 2*math.pi
        if v < -math.pi:
            v += 2*math.pi
        joint_values[i] = v
    ### ***** HACK ***** ##### TODO: CHECK!!!
    
    configuration = [Configuration.from_revolute_values(joint_values)]

print(configuration)
# ---------- end inverse ----------

# ----
pln_4 = Plane(pln)

# ---- group: inverse kinematics
select_configuration_2 = Slider(0, range=0..7)
inverse_2 = PythonScript(robot=robot, group=info.main_group_name, plane_WCS=pln_4, idx=select_configuration_2)  # -> out, plane_tool0_RCS, plane_tcp_RCS, configuration; inputs plane_WCS: Plane, idx: Int32
# ---------- inverse_2: Python ----------
import Rhino.Geometry as rg
import math
from compas.geometry import Frame, Transformation, Rotation
from compas_fab.robots import Configuration
from ur_fabrication_control.kinematics.ur_kinematics import inverse_kinematics
from ur_fabrication_control.kinematics.ur_params import ur_params
from compas_ghpython import draw_frame

tcp_WCS = Frame(plane_WCS.Origin, plane_WCS.XAxis, plane_WCS.YAxis)

# transform frame to robot coordinate system
print tcp_WCS
print plane_WCS
tcp_RCS = robot.to_local_coordinates(tcp_WCS)
tool0_RCS = robot.from_tcf_to_t0cf([tcp_RCS])[0]
tool0_RCS_rot = Frame(tool0_RCS.point, tool0_RCS.zaxis, tool0_RCS.yaxis)
print tcp_RCS
print tool0_RCS
plane_tool0_RCS = draw_frame(tool0_RCS)
plane_tcp_RCS = draw_frame(tcp_RCS)
# calculate solutions to frame
ur_params = ur_params[robot.name] # get the parameters according to the robot model
print ur_params
solutions = inverse_kinematics(tool0_RCS, ur_params)
print solutions

if not len(solutions):
    joint_values = [0,0,0,0,0,0]
    configuration = Configuration.from_revolute_values(joint_values)
else:
    joint_values = solutions[idx]
    #print joint_values
    
    ### ***** HACK ***** ##### TODO: CHECK!!!
    for i, v in enumerate(joint_values):
        if v > math.pi:
            v -= 2*math.pi
        if v < -math.pi:
            v += 2*math.pi
        joint_values[i] = v
    ### ***** HACK ***** ##### TODO: CHECK!!!
    configuration = [Configuration.from_revolute_values(joint_values)]

print(configuration)
# ---------- end inverse_2 ----------

# ----
pln_5 = Plane(inverse.plane_tcp_RCS)

# ----
# 4.
list_8 = ValueList({"0 forward_kinematics": 0, "1 inverse_kinematics": 1, "2 inverse_kinematics": 2}, selected="0 forward_kinematics")
filter = StreamFilter(Gate=list_8, Stream0=forward_kinematics, Stream1=inverse_2.configuration, Stream2=inverse.configuration)

# ----
# Visualisation
show_end_effector_frame = BooleanToggle(True)
show_base_frame = BooleanToggle(True)
show_collision = BooleanToggle(False)
show_frames = BooleanToggle(True)
show_visual = BooleanToggle(True)
show_acm = BooleanToggle(False)
visualize = PythonScript(
    robot=robot,
    tool=python.tool,
    group=info.main_group_name,
    configuration=filter,
    redraw=py_7,
    show_visual=show_visual,
    show_collision=show_collision,
    show_end_effector_frame=show_end_effector_frame,
    show_frames=show_frames,
    show_base_frame=show_base_frame,
    show_acm=show_acm)  # -> out, robot, visual, collision, attached_meshes, frames, ee_frame, tool0_frame, base_frame; inputs redraw: list, attached_collision_meshes: list
# ---------- visualize: Python ----------
from compas.geometry import Vector
from compas.geometry import Point
from compas.geometry import Transformation
from compas.geometry import Frame
from compas_ghpython.artists import MeshArtist
from compas_fab.robots import Configuration
from ur_fabrication_control.kinematics.ur_kinematics import forward_kinematics
from ur_fabrication_control.kinematics.ur_params import ur_params

print(configuration)

if robot and configuration:
    
    robot.update(configuration, visual=show_visual, collision=show_collision)
    ur_params = ur_params[robot.name]
    
    if show_visual:
        visual = robot.artist.draw_visual()

    if show_collision:
        collision = robot.artist.draw_collision()
    
    frames = robot.transformed_frames(configuration, group)

    if show_base_frame:
        base_frame = frames[0]

    if show_end_effector_frame:
        tool0_frame = forward_kinematics(configuration.revolute_values, ur_params)
#        tool0_frame = robot.forward_kinematics(configuration, group)
        print tool0_frame
        ee_frame = robot.from_t0cf_to_tcf([tool0_frame])
        print("End-effector", ee_frame)
    
    if not show_frames:
        frames = None

    frame = forward_kinematics(configuration.revolute_values, ur_params)
#    frame = robot.forward_kinematics(configuration, options=dict(solver='model', link_name=robot.attached_tool.link_name))
    robot.artist.update_tool(visual=visual, collision=collision, transformation=Transformation.from_frame_to_frame(Frame.worldXY(), tool0_frame))
    
    if show_acm:
        M = []
        for acm in attached_collision_meshes:
            frame = robot.forward_kinematics(configuration, options=dict(solver='model', link_name=acm.link_name))
            T = Transformation.from_frame_to_frame(Frame.worldXY(), frame)
            mesh = acm.collision_mesh.mesh.transformed(T)
            M.append(MeshArtist(mesh).draw())
        attached_meshes = M
# ---------- end visualize ----------
geo_2 = Geometry(visualize.visual)
geo_3 = Geometry(visualize.collision)
draw_2 = GhPythonScript(
    frames=[visualize.frames, visualize.ee_frame, visualize.base_frame, visualize.tool0_frame],
    scale=Slider(0.1, range=0..1))  # -> P, V, C, W; inputs frames: list
# ---------- draw_2: Python ----------
from System.Drawing import Color
from compas_ghpython.utilities import draw_frame

red = Color.FromArgb(255, 0, 0)
green = Color.FromArgb(0, 255, 0)
blue = Color.FromArgb(0, 0, 255)

P = []
V = []
C = []

scale = float(scale)

for frame in frames:
    if not frame:
        continue
    plane = draw_frame(frame)
    P += [plane.Origin] * 3
    V.append(plane.XAxis * scale)
    V.append(plane.YAxis * scale)
    V.append(plane.ZAxis * scale)
    C += [red, green, blue]

W = 3
# ---------- end draw_2 ----------
vdisex = VectorDisplayEx(Point=draw_2.P, Vector=draw_2.V, Colour=draw_2.C, Width=draw_2.W)
preview_3 = CustomPreview(Geometry=geo_2, Shader=ColourSwatch(SwatchColor=RGB(105, 105, 105)))
preview_4 = CustomPreview(Geometry=visualize.attached_meshes, Shader=ColourSwatch(SwatchColor=RGB(255, 255, 255)))

max_speed = Slider(4000, range=0..51200)
speed = Slider(1600, range=0..51200)
value = BooleanToggle(False)
send = Button()
extruder_data = PythonScript(motor_state=value, max_speed=max_speed, speed=speed, send=send)  # -> urscript; inputs motor_state: Int32
# ---------- extruder_data: Python ----------
import time
from scriptcontext import sticky as st
from mobile_additive_manufacturing.control.clay_extruder_control import ExtruderClient

ext_ip = st["ext_ip"]
ext_port = st["ext_port"]

ec = ExtruderClient(ext_ip, ext_port)
wait_for_response = False

if send:
    ec.connect()
    time.sleep(0.2)
    ec.send_motordata(motor_state, max_speed, speed, wait_for_response)
    time.sleep(0.2)
    ec.close()
# ---------- end extruder_data ----------

# ---- group: Only needs to be created once
overwrite = Button()
# 5.
create_3 = Button()
fabrication = GhPythonScript(create=create_3, overwrite=overwrite)  # -> out, fabrication
# ---------- fabrication: Python ----------
__author__ = "Gido"
__version__ = "2020.01.14"

from scriptcontext import sticky as st
from ur_fabrication_control.direct_control.fabrication_process import Fabrication

server_ip = st["server_address"]
server_port = st["server_port"]

fabrication_key = "fabrication"

if fabrication_key not in st:
    st[fabrication_key] = None

if overwrite and st[fabrication_key] != None:
    fabrication = st[fabrication_key]
    if hasattr(fabrication, 'task_thread') and hasattr(fabrication, 'listen_thread'):
        fabrication._join_threads()

if (create and st[fabrication_key] == None) or overwrite:
    fabrication = Fabrication()
    fabrication.set_feedback_server(server_ip, server_port)
    
    st[fabrication_key] = fabrication

fabrication = st[fabrication_key]
# ---------- end fabrication ----------

# ----
send_2 = Button()
get_info = PythonScript(send=send_2)  # -> info
# ---------- get_info: Python ----------
import time
from scriptcontext import sticky as st
from mobile_additive_manufacturing.control.clay_extruder_control import ExtruderClient

ext_ip = st["ext_ip"]
ext_port = st["ext_port"]

ec = ExtruderClient(ext_ip, ext_port)
wait_for_response = True

if send:
    ec.connect()
    time.sleep(0.2)
    info = ec.send_get_arduino_info(wait_for_response)
    time.sleep(0.2)
    ec.close()
# ---------- end get_info ----------

# ----
# Direct extruder control
panel_6 = Panel(get_info)

bang_2 = Button()
unload_2 = PythonScript(bang=bang_2)
# ---------- unload_2: Python ----------
from compas_rhino.utilities.misc import get_tolerance
from compas_rhino.utilities.misc import unload_modules

unload_modules("compas")
unload_modules("compas_fab")
unload_modules("ur_fabrication_control")
unload_modules("mobile_additive_manufacturing")
unload_modules("am_information_model")
# ---------- end unload_2 ----------

value_2 = BooleanToggle(True)
send_3 = Button()
extruder_state = PythonScript(state=value_2, send=send_3)  # -> urscript; inputs state: Boolean
# ---------- extruder_state: Python ----------
import time
from scriptcontext import sticky as st
from mobile_additive_manufacturing.control.clay_extruder_control import ExtruderClient

ext_ip = st["ext_ip"]
ext_port = st["ext_port"]

ec = ExtruderClient(ext_ip, ext_port)
wait_for_response = False

if send:
    ec.connect()
    time.sleep(0.2)
    ec.send_motorstate(0, int(state), wait_for_response)
    time.sleep(0.2)
    ec.close()
# ---------- end extruder_state ----------

undo_task = Button()
skip_task = Button()

# ----
# Continuous fabrication
ur_speed = Slider(0.012, range=0..1)
ext_speed = Slider(1600, range=0..4000)
ext_accel = Slider(4000, range=0..4000)
include_extruder = BooleanToggle(True)
Z = UnitZ(Factor=Slider(0.6, range=0..1))
pln_6 = Plane(Plane(origin=(-0.5813372945, -0.04765815763, -0.449495498), x=(-0.01795929223, -0.9998379119, 0.001270365803), y=(-0.9997696103, 0.0179729749, 0.01173449636)))
create_tasks = Button()
send_data = Button()
start_3 = Button()
stop_3 = Button()
move = Move(Geometry=pln_6, Motion=Z)  # -> Geometry, Transform
timer = Timer(Interval=1000, TimerInterval=1000, Target=continuous_operation_multiple_layers)
continuous_operation_multiple_layers = GhPythonScript(
    fabrication=fabrication.fabrication,
    am_model=generate_assembly,
    am_safety_plane=move.Geometry,
    robot=robot,
    ur_speed=ur_speed,
    ext_speed=ext_speed,
    ext_maxspeed=ext_accel,
    create_tasks=create_tasks,
    send_extruder_data=send_data,
    include_extruder=include_extruder,
    start=start_3,
    stop=stop_3,
    skip_task=skip_task,
    undo_task=undo_task)  # -> out, msgs, states, tasks, exit_msgs, current_task, task_key_current, fabrication
# ---------- continuous_operation_multiple_layers: Python ----------
from scriptcontext import sticky as st

import sys, os
am_hackathon_path = os.path.abspath(os.path.join(ghdoc.Path,"../../src"))
if am_hackathon_path not in sys.path:
    sys.path.append(am_hackathon_path)

from compas.geometry import Frame
from compas.geometry import Translation
from compas.geometry import Transformation
from compas.geometry import Vector
from compas_ghpython import update_component
from mobile_additive_manufacturing.control import URScript_Extrusion
from mobile_additive_manufacturing.control import set_extruder_data
from ur_fabrication_control.direct_control import URScript
from ur_fabrication_control.direct_control.mixins.airpick_mixins import AirpickMixins
from ur_fabrication_control.direct_control.fabrication_process import Fabrication

ur_ip = st["ur_ip"]
ur_port = st["ur_port"]
server_ip = st["server_address"]
server_port = st["server_port"]
ext_ip = st["ext_ip"]
ext_port = st["ext_port"]


def create_tasks_from_am_model(am_model):
    for key, layer in am_model.layers():
        if key == 0:
            toggle_extruder = True
        elif key == am_model.number_of_layers()-1:
            toggle_extruder = False
        else:
            toggle_extruder = None
        exit_message = "Layer{}_completed".format(key)
        layer_urscript = get_layer_ur_script(layer, toggle_extruder, exit_message)
        fabrication.add_task(layer_urscript, exit_message)

def get_frames_in_RCS(frames):
    return [robot.to_local_coordinates(frame) for frame in frames]

def get_layer_ur_script(layer, toggle_extruder, exit_message):
    ur_script = URScript_Extrusion(ur_ip=ur_ip, ur_port=ur_port, ext_ip=ext_ip, ext_port=ext_port)
    tool_angle_axis = list(robot.attached_tool.frame.point) + list(robot.attached_tool.frame.axis_angle_vector)
    
    ur_script.start()
    ur_script.set_tcp(tool_angle_axis)
    RCS_frames = get_frames_in_RCS([node.frame for key, node in layer.nodes()])
    first = False
    for key, node in layer.nodes():
        if key in [0]:
            ur_script.move_linear(robot.to_local_coordinates(node.frame), velocity=ur_speed, radius=node.radius)
            if (toggle_extruder == True) and (toggle_extruder != None) and include_extruder:
                toggle_extrusion(ur_script, 1)
        else:
            ur_script.move_process(robot.to_local_coordinates(node.frame), ur_speed, node.radius)
    else:
        if (toggle_extruder == False) and (toggle_extruder != None) and include_extruder:
            toggle_extrusion(ur_script, 0)
    # Signify ready
    ur_script.socket_open(server_ip, server_port, "Feedbackserver")
    ur_script.socket_send_line_string(exit_message, socket_name="Feedbackserver")
    ur_script.socket_close(name="Feedbackserver")
    #Finalize script
    ur_script.end()
    ur_script.generate()
    return ur_script

def get_stop_ur_script(safety_plane):
    safety_frame_WCS = Frame(safety_plane.Origin, safety_plane.XAxis, safety_plane.YAxis)
    safety_frame_RCS = robot.to_local_coordinates(safety_frame_WCS)
    
    ur_script = URScript_Extrusion(ur_ip=ur_ip, ur_port=ur_port, ext_ip=ext_ip, ext_port=ext_port)
    tool_angle_axis = list(robot.attached_tool.frame.point) + list(robot.attached_tool.frame.axis_angle_vector)
    
    ur_script.start()
    ur_script.set_tcp(tool_angle_axis)
    if include_extruder:
        toggle_extrusion(ur_script, 0)
    ur_script.move_linear(safety_frame_RCS, velocity=ur_speed, radius=0)
    ur_script.end()
    ur_script.generate()
    return ur_script

def toggle_extrusion(ur_script, state):
    ur_script.open_socket_extruder()
    if state==1:
        ur_script.toggle_fan(state=state)
    ur_script.toggle_air(state=state)
    ur_script.set_extruder_data(state=state, max_speed=ext_maxspeed, speed=ext_speed)
    ur_script.close_socket_extruder()

if create_tasks:
    fabrication.current_task = 0
    fabrication.clear_tasks()
    fabrication.stop_task = get_stop_ur_script(am_safety_plane)
    create_tasks_from_am_model(am_model)

if send_extruder_data:
    set_extruder_data(ur_ip, ur_port, ext_ip, ext_port, 0, ext_maxspeed, ext_speed)

if stop:
    fabrication.stop()

if start:
    fabrication.start()

if skip_task:
    skip_key = fabrication.get_next_task()
    fabrication.tasks[skip_key]["state"] = "completed"
    fabrication.current_task+=1

if undo_task:
    undo_key = fabrication.get_next_task()-1
    fabrication.tasks[undo_key]["state"] = "waiting"
    if fabrication.current_task != 0:
        fabrication.current_task-=1

try:
    fab = fabrication
except NameError:
    fabrication = None
else:
    task_dict = fabrication.tasks.values()
    if fabrication.tasks_available():
        if fabrication.current_task == None:
            task_key_current = fabrication.get_next_task()
        else:
            task_key_current = fabrication.current_task
        current_task = task_dict[task_key_current]["task"].script
    tasks = []
    states = []
    exit_msgs = []
    for task in task_dict:
        tasks.append(task["task"])
        states.append(task["state"])
        exit_msgs.append(task["exit_message"])
    msgs = fabrication.server.msgs.values()
# ---------- end continuous_operation_multiple_layers ----------
server_messages = Panel(continuous_operation_multiple_layers.msgs)
states = Panel(continuous_operation_multiple_layers.states)
current_task = Panel(continuous_operation_multiple_layers.current_task)
tasks = Panel(continuous_operation_multiple_layers.tasks)
exit_message = Panel(continuous_operation_multiple_layers.exit_msgs)

idx_2 = Panel(continuous_operation_multiple_layers.task_key_current)

stop_4 = Button()
stop_5 = PythonScript(stop=stop_4)
# ---------- stop_5: Python ----------
import time
from scriptcontext import sticky as st
from mobile_additive_manufacturing.control.clay_extruder_control import ExtruderClient

ext_ip = st["ext_ip"]
ext_port = st["ext_port"]

ec = ExtruderClient(ext_ip, ext_port)
wait_for_response = False

if stop:
    ec.connect()
    time.sleep(0.2)
    ec.send_stop(wait_for_response)
    time.sleep(0.2)
    ec.close()
# ---------- end stop_5 ----------

stop_6 = Button()
stop_7 = PythonScript(stop=stop_6)
# ---------- stop_7: Python ----------
from scriptcontext import sticky as st
from ur_fabrication_control.direct_control.common import send_stop

ur_ip = st["ur_ip"]
ur_port = st["ur_port"]

if stop:
    send_stop(ur_ip, ur_port)
# ---------- end stop_7 ----------

list_9 = ValueList({"30", "32", "34"}, selected="30")

value_3 = BooleanToggle(False)
send_4 = Button()
digital_out = PythonScript(pin=list_9, state=value_3, send=send_4)  # -> urscript; inputs pin: Int32, state: Boolean
# ---------- digital_out: Python ----------
import time
from scriptcontext import sticky as st
from mobile_additive_manufacturing.control.clay_extruder_control import ExtruderClient

ext_ip = st["ext_ip"]
ext_port = st["ext_port"]

ec = ExtruderClient(ext_ip, ext_port)
wait_for_response = False

if send:
    ec.connect()
    time.sleep(0.2)
    ec.send_set_do(pin, int(state), wait_for_response)
    time.sleep(0.2)
    ec.close()
# ---------- end digital_out ----------

list_10 = ValueList({"30", "32", "34"}, selected="34")

value_4 = BooleanToggle(True)
send_5 = Button()
digital_out_2 = PythonScript(pin=list_10, state=value_4, send=send_5)  # -> urscript; inputs pin: Int32, state: Boolean; same code as digital_out

list_11 = ValueList({"30", "32", "34"}, selected="32")

value_5 = BooleanToggle(True)
send_6 = Button()
digital_out_3 = PythonScript(pin=list_11, state=value_5, send=send_6)  # -> urscript; inputs pin: Int32, state: Boolean; same code as digital_out

number = Slider(7, range=0..10)
value_6 = BooleanToggle(True)
digital_out_4 = PythonScript(number=number, value=value_6)  # -> urscript; inputs number: Int32, value: Boolean
# ---------- digital_out_4: Python ----------
from ur_fabrication_control.direct_control import URScript

urscript = URScript()
urscript.start()
urscript.add_line("\tset_digital_out({}, {})".format(number, value))
urscript.end()
urscript = urscript.generate()

print(urscript)
# ---------- end digital_out_4 ----------
send_7 = Button()
send_8 = GhPythonScript(urscript=digital_out_4, send=send_7)  # -> out; inputs send: Boolean
# ---------- send_8: Python ----------
from scriptcontext import sticky as st
from ur_fabrication_control.direct_control import send_script

ur_ip = st["ur_ip"]
ur_port = st["ur_port"]

if send:
    send_script(urscript, ur_ip, ur_port)
# ---------- end send_8 ----------

max_speed_2 = Slider(4000, range=0..51200)
speed_2 = Slider(1600, range=0..51200)

get = Button()
pose = PythonScript(get=get)  # -> pose_cartesian, frame_WCS, plane_WCS
# ---------- pose: Python ----------
from scriptcontext import sticky as st
from ur_fabrication_control.direct_control.common import get_current_pose_cartesian
from compas.geometry import Frame
from compas_ghpython import draw_frame

robot = st["robot_1"]

server_address = st["server_address"]
server_port = st["server_port"]
ur_port = st["ur_port_1"]
ur_ip = st["ur_ip_1"]

# retrieve the current tool frame in axis angle format
if robot.attached_tool:
    tool_angle_axis = list(robot.attached_tool.frame.point) + list(robot.attached_tool.frame.axis_angle_vector)
else:
    tool0_frame = Frame([0, 0, 0], [1, 0, 0], [0, 1, 0])
    tool_angle_axis = list(tool0_frame.point) + list(tool0_frame.axis_angle_vector)

print(tool_angle_axis)

guid = str(ghenv.Component.InstanceGuid)
pose_cartesian_key = "pose_cartesian" + guid


if get:
    st[pose_cartesian_key] = get_current_pose_cartesian(tool_angle_axis, server_address, server_port, ur_ip, ur_port, send=True)

if pose_cartesian_key not in st:
    pose_cartesian = []
else:
    pose_cartesian = st[pose_cartesian_key]

print(pose_cartesian)

# get frame and plane of the current pose cartesian in world coordinates for visualization
if pose_cartesian:
    frame_RCS = Frame.from_axis_angle_vector(axis_angle_vector=pose_cartesian[3:], point=pose_cartesian[:3])
    frame_WCS = robot.to_world_coordinates(frame_RCS)
    plane_WCS  = draw_frame(frame_WCS)
    print frame_RCS
    print frame_WCS
# ---------- end pose ----------
draw_3 = GhPythonScript(frames=pose.frame_WCS, scale=Slider(0.1, range=0..1))  # -> P, V, W; inputs frames: list; same code as draw_2
vdisex_2 = VectorDisplayEx(Point=draw_3.P, Vector=draw_3.V, Colour=RGB(0, 0, 0), Width=draw_3.W)
panel_8 = Panel(pose.pose_cartesian)

add = Button()
list_12 = ValueList({"send all positions": 0, "send only one position": 1, "from inverse": 2}, selected="from inverse")
clear = Button()
idx_3 = Slider(0, range=0..100)
crv_6 = Curve(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)
hframes = HorizontalFrames(Curve=crv_6, Count=10)  # -> Frames, Parameters
rec_car = PythonScript(msg=pose.plane_WCS, rec=add, clear=clear)  # -> rec
# ---------- rec_car: Python ----------
from scriptcontext import sticky as st

guid = str(ghenv.Component.InstanceGuid)
recorded_key =  "recorded_" + guid
just_cleared_key = "just_cleared_" + guid


if recorded_key not in st:
    st[recorded_key] = []

if just_cleared_key not in st:
    st[just_cleared_key] = False

if clear:
    st[recorded_key] = []
    st[just_cleared_key] = True
else:
    if len(msg):
        if msg != [None] and not st[just_cleared_key] and rec:
            st[recorded_key].append(msg)
    st[just_cleared_key] = False
        


rec = st[recorded_key]

print rec
# ---------- end rec_car ----------
item = ListItem(List=hframes.Frames, Index=idx_3, Wrap=True)
filter_2 = StreamFilter(Gate=list_12, Stream0=hframes.Frames, Stream1=item, Stream2=rec_car)
radius = Slider(0.5, range=0..0.5)
movel = PythonScript(planes_WCS=pln_4, velocity=Slider(0.075, range=0..0.5), radius=radius)  # -> urscript; inputs planes_WCS: list
# ---------- movel: Python ----------
import Rhino.Geometry as rg
from compas.geometry import Frame
from compas.geometry import Transformation, Rotation
from compas_ghpython import draw_frame
from compas_fab.robots import robot
from ur_fabrication_control import direct_control 
import math

from scriptcontext import sticky as st
from ur_fabrication_control.direct_control import URScript

robot = st["robot"]

# retrieve the current tool frame in axis angle format
if robot.attached_tool:
    tool_angle_axis = list(robot.attached_tool.frame.point) + list(robot.attached_tool.frame.axis_angle_vector)
else:
    tool0_frame = Frame([0, 0, 0], [1, 0, 0], [0, 1, 0])
    tool_angle_axis = list(tool0_frame.point) + list(tool0_frame.axis_angle_vector)

frames_RCS = []
for plane_WCS in planes_WCS:
    frame_WCS = Frame(plane_WCS.Origin, plane_WCS.XAxis, plane_WCS.YAxis)
    frame_RCS = robot.to_local_coordinates(frame_WCS)
    frames_RCS.append(frame_RCS)

urscript = URScript()
urscript.start()
urscript.moves_linear(frames_RCS, velocity, radius)
urscript.end()

urscript = urscript.generate()

print(urscript)
# ---------- end movel ----------
send_9 = Button()
send_10 = GhPythonScript(urscript=movel, send=send_9)  # -> out; inputs send: Boolean; same code as send_8

clear_2 = Button()
list_13 = ValueList({"send all positions": 0, "send only one position": 1, "from inverse": 2}, selected="from inverse")
add_2 = Button()
idx_4 = Slider(0, range=0..100)
crv_7 = Curve(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)
hframes_2 = HorizontalFrames(Curve=crv_7, Count=10)  # -> Frames, Parameters
rec_viacar = PythonScript(msg=pose.plane_WCS, rec=add_2, clear=clear_2)  # -> rec; same code as rec_car
item_2 = ListItem(List=hframes_2.Frames, Index=idx_4, Wrap=True)
filter_3 = StreamFilter(Gate=list_13, Stream0=hframes_2.Frames, Stream1=item_2, Stream2=rec_car)
filter_4 = StreamFilter(Gate=list_13, Stream0=hframes_2.Frames, Stream1=item_2, Stream2=rec_viacar)
radius_2 = Slider(0.5, range=0..0.5)
movec = PythonScript(planes_WCS=filter_3, planes_via_WCS=filter_4, velocity=Slider(0.075, range=0..0.5), radius=radius_2)  # -> urscript; inputs planes_WCS: list, planes_via_WCS: list
# ---------- movec: Python ----------
import Rhino.Geometry as rg
from compas.geometry import Frame
from compas.geometry import Transformation, Rotation
from compas_ghpython import draw_frame
from compas_fab.robots import robot
from ur_fabrication_control import direct_control 
import math

from scriptcontext import sticky as st
from ur_fabrication_control.direct_control import URScript

robot = st["robot"]

# retrieve the current tool frame in axis angle format
if robot.attached_tool:
    tool_angle_axis = list(robot.attached_tool.frame.point) + list(robot.attached_tool.frame.axis_angle_vector)
else:
    tool0_frame = Frame([0, 0, 0], [1, 0, 0], [0, 1, 0])
    tool_angle_axis = list(tool0_frame.point) + list(tool0_frame.axis_angle_vector)

frames_RCS = []
for plane_WCS in planes_WCS:
    frame_WCS = Frame(plane_WCS.Origin, plane_WCS.XAxis, plane_WCS.YAxis)
    frame_RCS = robot.to_local_coordinates(frame_WCS)
    frames_RCS.append(frame_RCS)

frames_via_RCS = []
for plane_WCS in planes_via_WCS:
    frame_WCS = Frame(plane_WCS.Origin, plane_WCS.XAxis, plane_WCS.YAxis)
    frame_RCS = robot.to_local_coordinates(frame_WCS)
    frames_via_RCS.append(frame_RCS)

urscript = URScript()
urscript.start()
urscript.moves_circular(frames_via_RCS, frames_RCS, velocity, radius)
urscript.end()

urscript = urscript.generate()

print(urscript)
# ---------- end movec ----------
send_11 = Button()
send_12 = GhPythonScript(urscript=movec, send=send_11)  # -> out; inputs send: Boolean; same code as send_8

list_14 = ValueList({"send all positions": 0, "send only one position": 1, "from inverse": 2}, selected="from inverse")
idx_5 = Slider(0, range=0..100)
crv_8 = Curve(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)
hframes_3 = HorizontalFrames(Curve=crv_8, Count=10)  # -> Frames, Parameters
item_3 = ListItem(List=hframes_3.Frames, Index=idx_5, Wrap=True)
filter_5 = StreamFilter(Gate=list_14, Stream0=hframes_3.Frames, Stream1=item_3, Stream2=rec_car)
radius_3 = Slider(0.5, range=0..0.5)
movep = PythonScript(planes_WCS=filter_5, velocity=Slider(0.075, range=0..0.5), radius=radius_3)  # -> urscript; inputs planes_WCS: list
# ---------- movep: Python ----------
import Rhino.Geometry as rg
from compas.geometry import Frame
from compas.geometry import Transformation, Rotation
from compas_ghpython import draw_frame
from compas_fab.robots import robot
from ur_fabrication_control import direct_control 
import math

from scriptcontext import sticky as st
from ur_fabrication_control.direct_control import URScript

robot = st["robot"]

# retrieve the current tool frame in axis angle format
if robot.attached_tool:
    tool_angle_axis = list(robot.attached_tool.frame.point) + list(robot.attached_tool.frame.axis_angle_vector)
else:
    tool0_frame = Frame([0, 0, 0], [1, 0, 0], [0, 1, 0])
    tool_angle_axis = list(tool0_frame.point) + list(tool0_frame.axis_angle_vector)

frames_RCS = []
for plane_WCS in planes_WCS:
    frame_WCS = Frame(plane_WCS.Origin, plane_WCS.XAxis, plane_WCS.YAxis)
    frame_RCS = robot.to_local_coordinates(frame_WCS)
    frames_RCS.append(frame_RCS)

urscript = URScript()
urscript.start()
urscript.moves_process(frames_RCS, velocity, radius)
urscript.end()

urscript = urscript.generate()

print(urscript)
# ---------- end movep ----------
send_13 = Button()
send_14 = GhPythonScript(urscript=movep, send=send_13)  # -> out; inputs send: Boolean; same code as send_8

get_2 = Button()
pose_2 = PythonScript(get=get_2)  # -> configuration, pose_joints
# ---------- pose_2: Python ----------
from scriptcontext import sticky as st
from ur_fabrication_control.direct_control.common import get_current_pose_joints
from compas_fab.robots import Configuration


robot = st["robot"]

server_address = st["server_address"]
server_port = st["server_port"]
ur_port = st["ur_port"]
ur_ip = st["ur_ip"]


guid = str(ghenv.Component.InstanceGuid)
pose_joints_key = "pose_joints" + guid


# send script to the robot to receive the current joint configuration
if get:
    st[pose_joints_key] = get_current_pose_joints(server_address, server_port, ur_ip, ur_port, send=True)

if pose_joints_key not in st:
    configuration = Configuration.from_revolute_values([0,0,0,0,0,0])
else:
    configuration = Configuration.from_revolute_values(st[pose_joints_key])

pose_joints = configuration.values
# ---------- end pose_2 ----------
panel_9 = Panel(pose_2.pose_joints)

value_7 = BooleanToggle(True)
send_15 = Button()
extruder_data_2 = PythonScript(motor_state=value_7, max_speed=max_speed_2, speed=speed_2, send=send_15)  # -> urscript; inputs motor_state: Int32
# ---------- extruder_data_2: Python ----------
from scriptcontext import sticky as st
from mobile_additive_manufacturing.control.urscript_extrusion import URScript_Extrusion

ur_ip = st["ur_ip"]
ur_port = st["ur_port"]
ext_ip = st["ext_ip"]
ext_port = st["ext_port"]

def __wrap(func, *args, **kwargs):
    urscript = URScript_Extrusion(*args)
    urscript.start()
    urscript.open_socket_extruder()
    func(urscript, **kwargs)
    urscript.close_socket_extruder()
    urscript.end()
    urscript.generate()
    return urscript

def set_extruder_data(ur_ip, ur_port, ext_ip, ext_port,
                      state=0, max_speed=4000, speed=400):
    urs = __wrap(URScript_Extrusion.set_extruder_data,
           ur_ip, ur_port, ext_ip, ext_port,
           state=state, max_speed=max_speed, speed=speed)
    script = urs.script
    return urs

urs = set_extruder_data(ur_ip, ur_port, ext_ip, ext_port, motor_state, max_speed, speed)
if send:
    urs.send_script()
# ---------- end extruder_data_2 ----------

max_speed_3 = Slider(4000, range=0..51200)
speed_3 = Slider(1600, range=0..51200)

# ----
# Extruder control through UR
send_16 = Button()
get_info_2 = PythonScript(send=send_16)  # -> info
# ---------- get_info_2: Python ----------
from scriptcontext import sticky as st
from mobile_additive_manufacturing.control.urscript_extrusion import get_extruder_info

ur_ip = st["ur_ip"]
ur_port = st["ur_port"]
ext_ip = st["ext_ip"]
ext_port = st["ext_port"]

if send:
    get_extruder_info(ur_ip, ur_port, ext_ip, ext_port)
# ---------- end get_info_2 ----------

value_8 = BooleanToggle(True)
send_17 = Button()
extruder_data_3 = PythonScript(motor_state=value_8, max_speed=max_speed_3, speed=speed_3, send=send_17)  # -> urscript; inputs motor_state: Int32
# ---------- extruder_data_3: Python ----------
from scriptcontext import sticky as st
from mobile_additive_manufacturing.control.urscript_extrusion import set_extruder_data

ur_ip = st["ur_ip"]
ur_port = st["ur_port"]
ext_ip = st["ext_ip"]
ext_port = st["ext_port"]

if send:
    set_extruder_data(ur_ip, ur_port, ext_ip, ext_port, motor_state, max_speed, speed)
# ---------- end extruder_data_3 ----------

value_9 = BooleanToggle(True)
send_18 = Button()
extruder_state_2 = PythonScript(state=value_9, send=send_18)  # -> urscript; inputs state: Int32
# ---------- extruder_state_2: Python ----------
from scriptcontext import sticky as st
from mobile_additive_manufacturing.control.urscript_extrusion import toggle_extruder

ur_ip = st["ur_ip"]
ur_port = st["ur_port"]
ext_ip = st["ext_ip"]
ext_port = st["ext_port"]

if send:
    toggle_extruder(ur_ip, ur_port, ext_ip, ext_port, state)
# ---------- end extruder_state_2 ----------

# ----
# Measure basis:
# 1. Clear the recorded poses
# 2. Move robot to origin and press "get pose"
# 3. Move robot to point in positive x-axis and press "get pose"
# 4. Move robot to an other point in your basis and press "get pose"
# (The further away these positions are, the better)
# 
# 5. Alternatively change the order in the component calc base
# 6. Copy output into base component (TODO: check if it has to be inverted)
list_15 = ValueList({"o, pos.x-axis, xy pl": 0, "o, pos.y-axis, xy pl": 1}, selected="o, pos.x-axis, xy pl")
clear_3 = Button()
rec = PythonScript(msg=pose.pose_cartesian, rec=get, clear=clear_3)  # -> rec; inputs msg: list; same code as rec_car
calc_base = PythonScript(poses=rec, input_type=list_15)  # -> out, base_plane; inputs poses: list
# ---------- calc_base: Python ----------
import Rhino.Geometry as rg
import math


if len(poses) > 2:
    
    O = poses[0]
    P1 = poses[1]
    P2 = poses[2]
    
    if input_type == 0:
        # origin, pt on positive x-axis, pt in xy plane
        origin = rg.Point3d(O[0], O[1], O[2])
        pt_on_xaxis = rg.Point3d(P1[0], P1[1], P1[2])
        pt_in_xyplane = rg.Point3d(P2[0], P2[1], P2[2])
        
        xaxis = pt_on_xaxis - origin
        xaxis.Unitize()
        
        v = pt_in_xyplane - origin
        zaxis = rg.Vector3d.CrossProduct(v, xaxis)
        zaxis.Unitize()
        
        # zaxis must look up!
        if math.acos(rg.Vector3d.ZAxis * zaxis) > math.acos(rg.Vector3d.ZAxis * -zaxis):
            zaxis = -zaxis
        
        yaxis = rg.Vector3d.CrossProduct(zaxis, xaxis)
    
    elif input_type == 1:
        # origin, pt on positive y-axis, pt in xy plane
        origin = rg.Point3d(O[0], O[1], O[2])
        pt_on_yaxis = rg.Point3d(P1[0], P1[1], P1[2])
        pt_in_xyplane = rg.Point3d(P2[0], P2[1], P2[2])
        
        yaxis = pt_on_yaxis - origin
        yaxis.Unitize()
        
        v = pt_in_xyplane - origin
        zaxis = rg.Vector3d.CrossProduct(v, yaxis)
        zaxis.Unitize()
        
        # zaxis must look up!
        if math.acos(rg.Vector3d.ZAxis * zaxis) > math.acos(rg.Vector3d.ZAxis * -zaxis):
            zaxis = -zaxis
        
        xaxis = rg.Vector3d.CrossProduct(yaxis, zaxis)
        
        
    print "Copy the following into base component:"
    print " "
    print "origin = [%.2f, %.2f, %.2f]" % tuple(list(origin))
    print "xaxis = [%.5f, %.5f, %.5f]" % tuple(list(xaxis))
    print "yaxis = [%.5f, %.5f, %.5f]" % tuple(list(yaxis))
    

#print rg.Vector3d.CrossProduct(rg.Vector3d.YAxis, rg.Vector3d.ZAxis)
#print rg.Vector3d.CrossProduct(rg.Vector3d.ZAxis, rg.Vector3d.XAxis)

    base_plane = rg.Plane(origin, xaxis, xaxis)
# ---------- end calc_base ----------
panel_10 = Panel(rec)
panel_11 = Panel(calc_base.out)

# ----
# Direct UR Control
config = GhPythonScript()  # -> out, joint_configs
# ---------- config: Python ----------
from compas_fab.robots import Configuration

values=[-0.737876, -1.64531, 1.740348, -0.367801, -0.37385, -0.110741]
joint_configs = [Configuration.from_revolute_values(values)]
# ---------- end config ----------
pln_7 = Plane(calc_base.base_plane)
list_16 = ValueList({"30", "32", "34"}, selected="30")
list_17 = ValueList({"30", "32", "34"}, selected="34")
list_18 = ValueList({"30", "32", "34"}, selected="32")

clear_4 = Button()
add_3 = Button()
idx_6 = Slider(0, range=0..100)
list_19 = ValueList({"send all positions": 0, "send only one position": 1, "from inverse": 2}, selected="from inverse")
rec_joints = PythonScript(msg=pose_2.configuration, rec=add_3, clear=clear_4)  # -> rec
# ---------- rec_joints: Python ----------
from scriptcontext import sticky as st

guid = str(ghenv.Component.InstanceGuid)
recorded_key =  "recorded_" + guid
just_cleared_key = "just_cleared_" + guid


if recorded_key not in st:
    st[recorded_key] = []

if just_cleared_key not in st:
    st[just_cleared_key] = False

if clear:
    st[recorded_key] = []
    st[just_cleared_key] = True
else:
    if msg != [None] and not st[just_cleared_key] and rec:
        st[recorded_key].append(msg)
    st[just_cleared_key] = False
        


rec = st[recorded_key]

print rec
# ---------- end rec_joints ----------
item_4 = ListItem(List=config.joint_configs, Index=idx_6, Wrap=True)
filter_6 = StreamFilter(Gate=list_19, Stream0=config.joint_configs, Stream1=item_4, Stream2=rec_joints)
movej = PythonScript(joint_configurations=forward_kinematics, velocity=Slider(0.3, range=0..0.5))  # -> urscript, values; inputs joint_configurations: list
# ---------- movej: Python ----------
from ur_fabrication_control.direct_control import URScript
import math


"""
for c in joint_configurations:
    for i,v in enumerate(c.values):
        #print v
        if v>math.pi:
            v-=2*math.pi
        if v<-math.pi:
            v+=2*math.pi
        c.values[i]=v
print joint_configurations
values = joint_configurations[0].values
print([math.degrees(v) for v in values])
"""

#joint_config = ["movej({}, v={})".format(c.values, velocity/10) for c in joint_configurations]

urscript = URScript()
urscript.start()
for jc in joint_configurations:
    urscript.move_joint(jc, velocity)
urscript.end()

urscript = urscript.generate()

print(urscript)
# ---------- end movej ----------
send_19 = Button()
send_20 = GhPythonScript(urscript=movej.urscript, send=send_19)  # -> out; inputs send: Boolean; same code as send_8

plane_init_guess = Plane(Plane(origin=(0, 0, 0), x=(0, -1, 0), y=(1, 0, 0)))
pt = Point([<point referenced from the Rhino model> x3])
calc_base_2 = PythonScript(poses=rec, pts_cad=pt, base_plane_init_guess=plane_init_guess, calc=Toggle(False))  # -> out, pts_mtip_init_guess, pts_mtip_fit, base_plane_fit; inputs poses: list, pts_cad: list of Point3d, base_plane_init_guess: Plane
# ---------- calc_base_2: Python ----------
import ghpythonlib.components as ghcomp
import Rhino.Geometry as rg
from scriptcontext import sticky as st
from compas.geometry import Frame
import math as m
import sys
from compas.rpc import Proxy # for calling the numpy function in CPython


if len(poses):
    
    # get points from poses
    pts_mtip = [rg.Point3d(p[0], p[1], p[2]) for p in poses]
    
    T_W_R_init_guess = rg.Transform.PlaneToPlane(rg.Plane.WorldXY, base_plane_init_guess)
    pts_mtip_init_guess = [ghcomp.Transform(pt, T_W_R_init_guess) for pt in pts_mtip]
    
    # format Rhino transformation
    T_W_R_init_guess_flattened = [float(f) for f in T_W_R_init_guess.ToFloatArray(True)]
    T_W_R_init_guess_list = [T_W_R_init_guess_flattened[i:(i + 4)] for i in range(0, len(T_W_R_init_guess_flattened), 4)]  

    # format ptsA and ptsB
    dataB = [list(pt) for pt in pts_cad]
    dataA = [list(pt) for pt in pts_mtip]
    
    # call the function
    max_iterations = 100
    
    if calc:
        icp_func = Proxy('ur_fabrication_control.optimisation.icp', python = 'C://Users//kathrind//anaconda3//envs//ur_fab//python.exe')
        
        print icp_func._python

        transformation, distances = icp_func.icp(dataA, dataB, init_guess=T_W_R_init_guess_list, max_iterations=max_iterations, tolerance=0.000001)
        
        print "distances", distances
        
        # format result
        T = rg.Transform.Identity
        for i in range(4):
            for j in range(4):
                code = "T.M%i%i = %f" % (i, j, transformation[i][j])
                print code
                exec(code)
        #print T
        
        # now transform the points with the transformation calculated
        pts_mtip_fit = [ghcomp.Transform(pt, T) for pt in pts_mtip]
        base_plane_fit = ghcomp.Transform(rg.Plane.WorldXY, T)
        
        
        #f = Frame(base_plane_fit)
        #print f.get_pose_quaternion()
        
        # correct the zvalue
        #base_plane_fit = ghcomp.Transform(base_plane_fit, rg.Transform.Translation(0,0,-3))
# ---------- end calc_base_2 ----------
pt_2 = Point(calc_base_2.pts_mtip_init_guess)
pt_3 = Point(calc_base_2.pts_mtip_fit)
pln_8 = Plane(calc_base_2.base_plane_fit)

stop_8 = Button()
stop_9 = PythonScript(stop=stop_8)
# ---------- stop_9: Python ----------
from scriptcontext import sticky as st
from mobile_additive_manufacturing.control.urscript_extrusion import stop_extruder

ur_ip = st["ur_ip"]
ur_port = st["ur_port"]
ext_ip = st["ext_ip"]
ext_port = st["ext_port"]

if stop:
    stop_extruder(ur_ip, ur_port, ext_ip, ext_port)
# ---------- end stop_9 ----------

value_10 = BooleanToggle(True)
send_21 = Button()
digital_out_5 = PythonScript(pin=list_16, state=value_10, send=send_21)  # -> urscript; inputs pin: Int32, state: Int32
# ---------- digital_out_5: Python ----------
from scriptcontext import sticky as st
from mobile_additive_manufacturing.control.urscript_extrusion import set_extruder_digital_out

ur_ip = st["ur_ip"]
ur_port = st["ur_port"]
ext_ip = st["ext_ip"]
ext_port = st["ext_port"]

if send:
    set_extruder_digital_out(ur_ip, ur_port, ext_ip, ext_port, pin, state)
# ---------- end digital_out_5 ----------

value_11 = BooleanToggle(True)
send_22 = Button()
digital_out_6 = PythonScript(pin=list_17, state=value_11, send=send_22)  # -> urscript; inputs pin: Int32, state: Int32
# ---------- digital_out_6: Python ----------
from scriptcontext import sticky as st
from mobile_additive_manufacturing.control.urscript_extrusion import toggle_fan

ur_ip = st["ur_ip"]
ur_port = st["ur_port"]
ext_ip = st["ext_ip"]
ext_port = st["ext_port"]

if send:
    toggle_fan(ur_ip, ur_port, ext_ip, ext_port, pin, state)
# ---------- end digital_out_6 ----------

value_12 = BooleanToggle(True)
send_23 = Button()
digital_out_7 = PythonScript(pin=list_18, state=value_12, send=send_23)  # -> urscript; inputs pin: Int32, state: Int32
# ---------- digital_out_7: Python ----------
from scriptcontext import sticky as st
from mobile_additive_manufacturing.control.urscript_extrusion import toggle_air

ur_ip = st["ur_ip"]
ur_port = st["ur_port"]
ext_ip = st["ext_ip"]
ext_port = st["ext_port"]

if send:
    toggle_air(ur_ip, ur_port, ext_ip, ext_port, pin, state)
# ---------- end digital_out_7 ----------

# ---- group: Visualization
# VISUALIZATION
toggle_2 = BooleanToggle(True)
visualize_2 = GhPythonScript(wall=wave.wall, show_mesh=toggle_2, show_vertices_gate=Toggle(True), show_vector_field=Toggle(False))  # -> out, rhmesh, rhmesh_offset, vertices_gate, vertices_all, disp_vectors
# ---------- visualize_2: Python ----------
from compas_ghpython.artists import MeshArtist
import Rhino.Geometry as rg

rh_mesh = []
vertices_gate = []
vertices_all = []
disp_vectors = []


if show_mesh:
    # Mesh Artist for visualization
    artist = MeshArtist(wall.mesh)
    
    #vertices = artist.draw_vertices()
    #edges = artist.draw_edges()
    #faces = artist.draw_faces()
    #labels = {key: key for key in mesh.vertices()}
    
    rhmesh = artist.draw_mesh()
    
    artist_offset = MeshArtist(wall.mesh_offset)
    rhmesh_offset = artist_offset.draw_mesh()

if show_vertices_gate:
    # draw gate points
    v = []
    for vertex in wall.mesh.vertices():
        gp = wall.mesh.vertex_attribute(vertex, name='in_gate')
        if gp: v.append(vertex)
    
    #print v
    if len(v): vertices_gate = artist.draw_vertices(vertices=v)


if show_vector_field:
    x_disp = []
    z_disp = []
    
    for vertex in wall.mesh.vertices():
        x_disp.append(wall.mesh.vertex_attribute(vertex, name='x_disp'))
        z_disp.append(wall.mesh.vertex_attribute(vertex, name='z_disp'))
    
    disp_vectors = [rg.Vector3d(x_disp[i], 0, z_disp[i])/5 for i in range(len(x_disp))]

    vertices_all = artist.draw_vertices()
# ---------- end visualize_2 ----------
mesh = Mesh(visualize_2.rhmesh)
pt_4 = Point(visualize_2.vertices_gate)
pt_5 = Point(visualize_2.vertices_all)
vec = Vector(visualize_2.disp_vectors)
preview_5 = CustomPreview(Geometry=pt_4, Material=ColourSwatch(SwatchColor=RGB(0, 0, 0)))
vdisex_3 = VectorDisplayEx(Point=pt_5, Vector=vec, Colour=ColourSwatch(SwatchColor=RGB(42, 0, 255)), Width=1)

# ----
mesh_2 = Mesh(visualize_2.rhmesh_offset)

# ---- group: Visualization (continued)
preview_6 = CustomPreview(Geometry=[mesh, mesh_2], Material=ColourSwatch(SwatchColor=RGBA(255, 207, 207, 55)))

# ---- group: Fabrication
# FABRICATION
list_20 = ValueList({"1:10": 0.1, "1:5": 0.2}, selected="1:10")
div_len = GhPythonScript(scalefactor=list_20)  # -> out, max_layer_height, avg_layer_height, min_layer_height
# ---------- div_len: Python ----------
max_layer_height = 0.0065 / scalefactor
avg_layer_height = 0.0045 / scalefactor
min_layer_height = 0.0030 / scalefactor
print (avg_layer_height)
# ---------- end div_len ----------
print_path_generation = GhPythonScript(
    max_layer_height=div_len.max_layer_height,
    avg_layer_height=div_len.avg_layer_height,
    min_layer_height=div_len.min_layer_height,
    angle_constraint="25",
    crv_gate_left=define_gate.gate_crv_left,
    crv_gate_right=define_gate.gate_crv_right,
    crv_wall_left=define_gate.wall_crv_left,
    crv_wall_right=define_gate.wall_crv_right,
    crv_gate_top=define_gate.wall_crv_middle,
    blend_layers="25")  # -> out, pts_gate_left, pts_wall_left, pts_gate_right, pts_wall_right, crvs_region_left, crvs_region_right, crvs_region_left_top, crvs_region_right_top, crvs_region_top; inputs crv_gate_left: Curve, crv_gate_right: Curve, crv_wall_left: Curve, crv_wall_right: Curve, crv_gate_top: Curve, blend_layers: Int32
# ---------- print_path_generation: Python ----------
import Rhino.Geometry as rg
import ghpythonlib.components as ghcomp
import math



# planes gate left
tsl = crv_gate_left.DivideByLength(avg_layer_height, True)
div_count = len(tsl)
tsc = crv_gate_left.DivideByCount(div_count, True)
planes_gate_left = [crv_gate_left.PerpendicularFrameAt(t)[1] for t in tsc]

# planes gate right
tsc = crv_gate_right.DivideByCount(len(tsl), True)
planes_gate_right = [crv_gate_right.PerpendicularFrameAt(t)[1] for t in tsc]

# planes wall left
tsl = crv_wall_left.DivideByLength(avg_layer_height, True)
planes_wall_left = [crv_wall_left.PerpendicularFrameAt(t)[1] for t in tsl]

# planes wall right
tsr = crv_wall_right.DivideByLength(avg_layer_height, True)
planes_wall_right = [crv_wall_right.PerpendicularFrameAt(t)[1] for t in tsr]

top_wall_left = rg.Curve.Split(crv_wall_left, t=tsl[len(planes_gate_left)-1])[1]
top_wall_right = rg.Curve.Split(crv_wall_right, t=tsr[len(planes_gate_right)-1])[1]

#planes_wall_left_top = planes_wall_left[len(planes_gate_left):]
#planes_wall_right_top = planes_wall_right[len(planes_gate_right):]

# planes gate top
#tsc = crv_gate_top.DivideByCount(len(planes_wall_right_top), False)
#planes_gate_top = [crv_gate_top.PerpendicularFrameAt(t)[1] for t in tsc]

tsc = crv_gate_top.DivideByLength(max_layer_height, True)
planes_gate_top = [crv_gate_top.PerpendicularFrameAt(t)[1] for t in tsc[1:]]

twl = top_wall_left.DivideByCount(len(planes_gate_top)+1, False)
twr = top_wall_right.DivideByCount(len(planes_gate_top)+1, False)
planes_wall_left_top = [top_wall_left.PerpendicularFrameAt(t)[1] for t in twl]
planes_wall_right_top = [top_wall_right.PerpendicularFrameAt(t)[1] for t in twr]


class BlendFunction():
    def __init__(self, func_type, count, blend_layers=0):
        self.count = count
        self.blend_layers = int(min(blend_layers, count/2))
        self.func_type = func_type
        self.blend_type = {
            "linear" : self.blend_linear,
            "cosine" : self.blend_cosine
        }
    
    def get_value(self, value):
        return self.blend_type[self.func_type](value)
    
    def blend_cosine(self, value):
        if self.blend_layers != 0:
            if value <= self.blend_layers:
                step = (math.pi/self.blend_layers)*value
            elif value >= self.count-self.blend_layers:
                step = math.pi + (math.pi/self.blend_layers)*(value-(self.count-self.blend_layers))
            else:
                step = math.pi
        else:
            step = (2*math.pi/self.blend_layers)*value
        blendfactor = (math.cos(math.pi+step)+1)/2
        return blendfactor

    def blend_linear(self, value):
        blendfactor = (1/self.count)*value
        return blendfactor

def generate_crvs(planes_gate, planes_wall, region="left"):
    base_tangent = rg.Vector3d(1,0,0)
    if "left" in region:
        mult=-1
    elif "right" in region:
        mult = 1

    tangent_start_min = mult*base_tangent
    tangent_start_max = tangent_start_min.Clone()
    
    if region=="left" or region=="right":
        b_func = BlendFunction("cosine", len(planes_gate), blend_layers)
        tangent_start_max.Rotate(math.radians(-mult*angle_constraint), rg.Vector3d.YAxis)
    elif region=="topleft" or region=="topright":
        b_func = BlendFunction("linear", len(planes_gate), blend_layers)
        tangent_start_min.Rotate(math.radians(-mult*angle_constraint), rg.Vector3d.YAxis)
    
    crvs = []
    
    for i in range(len(planes_gate)):
        plane_gate = planes_gate[i]
        plane_wall = planes_wall[i]
        
        vertices = [plane_gate.Origin, plane_wall.Origin]
        
        normal = mult*plane_gate.XAxis
        
        if region!="topleft" and region!="topright":
            if i<len(planes_gate)/2:
                tangent_start = b_func.get_value(i)*normal + (1-b_func.get_value(i))*tangent_start_min
            else:
                tangent_start = b_func.get_value(i)*normal + (1-b_func.get_value(i))*tangent_start_max
            
        else:
            tangent_start = b_func.get_value(i)*normal + (1-b_func.get_value(i))*tangent_start_min
        
        tangent_end = mult*plane_wall.XAxis
        c, c_len, c_domain = ghcomp.Interpolatet(vertices, tangent_start, tangent_end, knotstyle=0)
        crvs.append(c)

    return crvs

crvs_region_left = generate_crvs(planes_gate_left, planes_wall_left, region="left")
crvs_region_right = generate_crvs(planes_gate_right, planes_wall_right, region="right")

crvs_region_left_top = generate_crvs(planes_gate_top, planes_wall_left_top, region="topleft")
crvs_region_right_top = generate_crvs(planes_gate_top, planes_wall_right_top, region="topright")

crvs_region_top = []
for i in range(len(crvs_region_left_top)):
    crvs = [crvs_region_left_top[i], crvs_region_right_top[i]]
    
    crv_joined = ghcomp.JoinCurves(crvs, False)
    crvs_region_top.append(crv_joined)
# ---------- end print_path_generation ----------
pt_6 = Point(print_path_generation.pts_gate_left)
pt_7 = Point(print_path_generation.pts_wall_left)
pt_8 = Point(print_path_generation.pts_gate_right)
pt_9 = Point(print_path_generation.pts_wall_right)
crv_9 = Curve(print_path_generation.crvs_region_left)
crv_10 = Curve(print_path_generation.crvs_region_right)
crv_11 = Curve(print_path_generation.crvs_region_left_top)
crv_12 = Curve(print_path_generation.crvs_region_right_top)
crv_13 = Curve(print_path_generation.crvs_region_top)
Y = UnitY(Factor=1)
projecttomesh = CSharpScript(Curve=[crv_9, crv_10, crv_11, crv_12, crv_13], Mesh=mesh, Direction=Y)  # -> out, A; inputs Curve: Curve, Mesh: Mesh, Direction: Vector3d; disabled
# ---------- projecttomesh: C# usings ----------
using System.IO;
using System.Linq;
using System.Data;
using System.Drawing;
using System.Reflection;
using System.Windows.Forms;
using System.Xml;
using System.Xml.Linq;
using System.Runtime.InteropServices;

using Rhino.DocObjects;
using Rhino.Collections;
using GH_IO;
using GH_IO.Serialization;
# ---------- projecttomesh: C# ----------
    if (null != Curve && null != Mesh && Direction.IsValid)
    {
      var tol = RhinoDoc.ActiveDoc.ModelAbsoluteTolerance;
      A = Curve.ProjectToMesh(Curve, Mesh, Direction, tol);
    }
# ---------- end projecttomesh ----------

# ----
# AM Information Model
number_slider = Slider(0.05, range=0..1)
layer_def = GhPythonScript(
    front_mesh=mesh,
    back_mesh=visualize_2.rhmesh_offset,
    crvs_region_left=print_path_generation.crvs_region_left,
    crvs_region_right=print_path_generation.crvs_region_right,
    crvs_region_top=print_path_generation.crvs_region_top,
    div_length=number_slider,
    scale=list_20,
    double_layer=toggle)  # -> out, path_crvs_region_left, path_crvs_region_right, path_crvs_region_top, layers_left, layers_right, layers_top, path_length_left, path_length_right, path_length_top; inputs front_mesh: Mesh, back_mesh: Mesh, crvs_region_left: list of Curve, crvs_region_right: list of Curve, crvs_region_top: list of Curve, double_layer: Boolean
# ---------- layer_def: Python ----------
import os
import sys
import json

import Rhino.Geometry as rg
import ghpythonlib.components as ghcomp
import rhinoscriptsyntax as rs

from compas.geometry import Frame
from compas.geometry import Line
from compas.geometry import Vector

from am_information_model.model import Node
from am_information_model.model import Layer

max_r = (div_length*scale)/3
print max_r

def project_crvs(crvs, mesh, direction=rg.Vector3d.YAxis, offset=0, reversed=False):
    proj_crvs = []
    for crv in crvs:
        proj_crv = rg.Curve.ProjectToMesh(crv, mesh, direction, 0.001)[0]
        crv_end_pts = ghcomp.EndPoints(crv)
        proj_end_pts = ghcomp.EndPoints(proj_crv)
        if Vector.from_start_end(crv_end_pts[0], proj_end_pts[0]).length>0.2:
            proj_crv.Reverse()
        if reversed:
            proj_crv.Reverse()
        proj_crv.Translate(0,offset,0)
        proj_crvs.append(proj_crv)
    return proj_crvs

#def mirror_curves(curves, offset):
#    new_crvs = []
#    for crv in curves:
#        crv_endpoints = ghcomp.EndPoints(crv)
#        mir_crv = ghcomp.Mirror(crv, rg.Plane.WorldZX)[0]
#        mir_crv.Translate(0,offset,0)
#        mir_crv_endpoints = ghcomp.EndPoints(mir_crv)
#        if Vector.from_start_end(crv_endpoints[0], mir_crv_endpoints[0]).length>offset:
#            mir_crv.Reverse()
#        new_crvs.append(mir_crv)
#    return new_crvs
#
#mirror_crvs_region_left = mirror_curves(proj_crvs_region_left, 0.320)
#mirror_crvs_region_right = mirror_curves(proj_crvs_region_right, 0.328)
#mirror_crvs_region_top = mirror_curves(proj_crvs_region_top, 0.328)

def layers_from_curves(curves, div, mir_curves=None, alternate=False, reversed=False):
    layers = []
    for j, crv in enumerate(curves):
        nodes = []
        crv_length = ghcomp.Length(crv)
        div_sections = int(crv_length/div)
        (pts, tans, pars) = ghcomp.DivideCurve(crv, div_sections, False)
        
        for i,pt in enumerate(pts):
            frame = Frame(pt, -rg.Vector3d(tans[i].X, 0, tans[i].Z), -Vector.Yaxis())
            nodes.append(Node(frame, radius=max_r))
        if not reversed:
            nodes.reverse()
        
        if mir_curves is not None:
            (mir_pts, mir_tans, mir_pars) = ghcomp.DivideCurve(mir_curves[j], div_sections, False)
            mir_nodes = []
            for i,pt in enumerate(mir_pts):
                frame = Frame(pt, -rg.Vector3d(tans[i].X, 0, tans[i].Z), -Vector.Yaxis())
                mir_nodes.append(Node(frame, radius=max_r))
            if reversed:
                mir_nodes.reverse()
            nodes.extend(mir_nodes)
        if alternate and j%2==0:
            nodes.reverse()
        layers.append(Layer.from_nodes(nodes))
    return layers

#layers_left = layers_from_curves(proj_crvs_region_left, mirror_crvs_region_left, div_length)
#layers_right = layers_from_curves(proj_crvs_region_right, mirror_crvs_region_right, div_length, reversed=True)
#layers_top = layers_from_curves(proj_crvs_region_top, mirror_crvs_region_top, div_length)

def create_closed_curves(crvs, mir_crvs, offset):
    new_crvs = []
    for i,crv in enumerate(crvs):
        crv_endpoints = ghcomp.EndPoints(crv)
        mir_crv_endpoints = ghcomp.EndPoints(mir_crvs[i])
        #if Vector.from_start_end(crv_endpoints[0], mir_crv_endpoints[0]).length>offset:
        #    mir_crv_endpoints.reverse()
        transverse_0 = rg.Line(mir_crv_endpoints[0], crv_endpoints[0])
        transverse_1 = rg.Line(crv_endpoints[1], mir_crv_endpoints[1])
        closed_crv = ghcomp.JoinCurves([crv, transverse_1, mir_crvs[i], transverse_0], False)
        new_crvs.append(closed_crv)
    return new_crvs

def get_lengths(curves):
    length = 0
    for crv in curves:
        length += crv.GetLength()*scale
    return length

#closed_crvs_region_left = create_closed_curves(proj_crvs_region_left, mirror_crvs_region_left, 0.328)
#closed_crvs_region_right = create_closed_curves(proj_crvs_region_right, mirror_crvs_region_right, 0.328)
#closed_crvs_region_top = create_closed_curves(proj_crvs_region_top, mirror_crvs_region_top, 0.328)

if double_layer:
    proj_crvs_region_left = project_crvs(crvs_region_left, front_mesh)
    proj_crvs_region_right = project_crvs(crvs_region_right, front_mesh, reversed=True)
    proj_crvs_region_top = project_crvs(crvs_region_top, front_mesh)
    
    back_vector = -rg.Vector3d.YAxis
    proj_crvs_region_left_back = project_crvs(crvs_region_left, back_mesh, direction=back_vector, offset=0.08)
    proj_crvs_region_right_back = project_crvs(crvs_region_right, back_mesh, direction=back_vector, offset=0.08, reversed=True)
    proj_crvs_region_top_back = project_crvs(crvs_region_top, back_mesh, direction=back_vector, offset=0.08)

    layers_left = layers_from_curves(proj_crvs_region_left, div_length, mir_curves=proj_crvs_region_left_back)
    layers_right = layers_from_curves(proj_crvs_region_right, div_length, mir_curves=proj_crvs_region_right_back, reversed=True)
    layers_top = layers_from_curves(proj_crvs_region_top, div_length, mir_curves=proj_crvs_region_top_back)
    
    path_crvs_region_left = create_closed_curves(proj_crvs_region_left, proj_crvs_region_left_back, 0.328)
    path_crvs_region_right = create_closed_curves(proj_crvs_region_right, proj_crvs_region_right_back, 0.328)
    path_crvs_region_top = create_closed_curves(proj_crvs_region_top, proj_crvs_region_top_back, 0.328)
    
    path_length_left = get_lengths(path_crvs_region_left)
    path_length_right = get_lengths(path_crvs_region_right)
    path_length_top = get_lengths(path_crvs_region_top)
    
else:
    path_crvs_region_left = project_crvs(crvs_region_left, front_mesh)
    path_crvs_region_right = project_crvs(crvs_region_right, front_mesh, reversed=True)
    path_crvs_region_top = project_crvs(crvs_region_top, front_mesh)
    
    layers_left = layers_from_curves(path_crvs_region_left, div_length, alternate=True)
    layers_right = layers_from_curves(path_crvs_region_right, div_length, alternate=True, reversed=True)
    layers_top = layers_from_curves(path_crvs_region_top, div_length, alternate=True)
    
    path_length_left = get_lengths(path_crvs_region_left)
    path_length_right = get_lengths(path_crvs_region_right)
    path_length_top = get_lengths(path_crvs_region_top)
# ---------- end layer_def ----------
cp_2 = Plane(Plane(origin=(-1.021847973, 0.2250490768, -0.4446056533), x=(-0.01795929223, -0.9998379119, 0.001270365803), y=(0.9997696103, -0.0179729749, -0.01173449636)))
generate_assembly_2 = GhPythonScript(
    create=create,
    centerplane=xy,
    scale=list_20,
    layers_left=layer_def.layers_left,
    layers_right=layer_def.layers_right,
    layers_top=layer_def.layers_top)  # -> am_model; inputs layers_left: list, layers_right: list, layers_top: list
# ---------- generate_assembly_2: Python ----------
import Rhino.Geometry as rg
import math
from scriptcontext import sticky as st


from compas.geometry import Frame
from compas.geometry import Transformation
from compas.geometry import Scale
from compas.geometry import Point

from compas_ghpython import draw_frame

from am_information_model.model import AMModel
from am_information_model.model import Layer

import Rhino.Geometry as rg

# initialize an empty assembly class

if "am_model" not in st:
    st["am_model"] = None

cp = centerplane
cf = Frame(cp.Origin, cp.XAxis, cp.YAxis)

S = Scale.from_factors([scale]*3, Frame.worldXY())
T = Transformation.from_frame_to_frame(Frame.worldXY(), cf)

def add_layers_to_am_model(amm, layers):
    for layer in layers:
        new_layer = layer.transformed(S)
        new_layer.transform(T)
        amm.add_layer(new_layer)

if create:
    new_amm = AMModel()
    add_layers_to_am_model(new_amm, layers_left)
    add_layers_to_am_model(new_amm, layers_right)
    add_layers_to_am_model(new_amm, layers_top)
    st["am_model"] = new_amm

am_model = st["am_model"]
# ---------- end generate_assembly_2 ----------

panel_12 = Panel(layer_def.path_length_right)
panel_13 = Panel(layer_def.path_length_top)
panel_14 = Panel(layer_def.path_length_left)

# ---- group: Visualise
# Layer visualization
counter_2 = CountThroughList(am_model=generate_assembly_2, start=start, stop=stop, step=step, step_back=back, reset=reset, full=full, interval=list_2)  # -> item, counter; inputs start: Boolean, stop: Boolean, step_back: Boolean
# ---------- counter_2: Python ----------
from scriptcontext import sticky as st
from compas_ghpython import update_component


L = list(am_model.layers())
# store data in component
guid = str(ghenv.Component.InstanceGuid)
counter_key = "counter_" + guid
running_key = "running_" + guid

if counter_key not in st:
    st[counter_key] = 0

if running_key not in st:
    st[running_key] = False
    

if st[running_key]:
    if st[counter_key] < len(L) - 1:
        st[counter_key] += 1
        update_component(ghenv, interval)
    else:
        st[counter_key] = 0
        st[running_key] = False
    
    
if start:
    st[running_key] = True

if stop:
    st[running_key] = False

if step:
    if st[counter_key] < len(L) - 1:
        st[counter_key] += 1

if step_back:
    if st[counter_key] > 0:
        st[counter_key] -= 1

if reset:
    st[counter_key] = 0

if full:
    st[counter_key] = len(L)-1

if len(L):
    item = L[st[counter_key]]



#st["visualisation_counter"] = st[counter_key]
counter = st[counter_key]
# ---------- end counter_2 ----------
show_4 = BooleanToggle(True)
show_5 = BooleanToggle(False)
idx_7 = Panel(counter_2.counter)
draw_4 = PythonScript(am_model=generate_assembly_2, show_all=show_4, show_counter=show_5, counter=idx_7)  # -> G, tool_planes_WCS, current_tool_plane, current_layer_planes; inputs counter: Int32; same code as draw
geo_4 = Geometry(draw_4.G)
pln_9 = Plane(draw_4.tool_planes_WCS)
pln_10 = Plane(draw_4.current_tool_plane)
pln_11 = Plane(draw_4.current_layer_planes)
preview_7 = CustomPreview(Geometry=geo_4, Shader=ColourSwatch(SwatchColor=RGBA(255, 186, 220, 146)))

# ----
data_2 = Data(generate_assembly_2)
